# Grasshopper definition Daylight projection.gh (Grasshopper 0.9.76)
# plug-ins: MeshEdit Components, Python Interpreter

path = FilePath("C:\Users\Antoine\Documents\BMan Modelling\tengwar-annatar-italics-quenya-pangram-e1365130074469.png")
honeybee = Honeybee_Honeybee()  # -> Vviiiiiiiiiizzz; plug-in component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
ladybug = Ladybug_Ladybug()  # -> Vviiiiiiiiiizzz; plug-in component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
pt = Point([<point referenced from the Rhino model> x2725])
img = ImportImage(File=path)
panel = Panel("https://www.energyplus.net/weather-download/europe_wmo_region_6/GBR//GBR_London.Gatwick.037760_IWEC/all")
shift = ShiftList(List=pt, Shift=1, Wrap=True)
srf = Surface([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])
ln = Line(StartPoint=pt, EndPoint=shift)
bbox = BoundingBox(Content=img, Plane=PlaneXY(0, 0, 0))  # -> Box, Box_2
polygon = Polygon(Plane=pt, Radius=Slider(1.5, range=0..2), Segments=8, FilletRadius=0)  # -> Polygon, Length
epw_stat = Ladybug_OpenEPWAndSTATWeatherFiles(weatherFileURL=panel)  # -> epwFile, statFile; plug-in component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
scale = Scale(Geometry=srf, Center=Point(0, 0, 0), Factor=Slider(0.95, range=0..1))  # -> Geometry, Transform
runion = RegionUnion(Curves=polygon.Polygon)
debrep = DeconstructBrep(Brep=bbox.Box)  # -> Faces, Edges, Vertices
scale_2 = Scale(Geometry=srf, Center=Point(0, 0, 0), Factor=Slider(0.9, range=0..1))  # -> Geometry, Transform
number_slider = Slider(250, range=0..1000)
dim = Dimensions(Surface=debrep.Faces)  # -> UDimension, VDimension
pi = Pi(Factor=Slider(1.72, range=0..2))
pi_2 = Pi(Factor=Slider(0.28, range=0..2))
join = BrepJoin(Breps=scale_2.Geometry)  # -> Breps, Closed
yz = YZPlane(Origin=Point(0, 0, 0))
importepw = Ladybug_ImportEpw(epwFile=epw_stat.epwFile)  # -> readMe, latitude, location, dryBulbTemperature, dewPointTemperature, relativeHumidity, windSpeed, windDirection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; plug-in component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
division = Division(A=dim.UDimension, B=dim.VDimension)
one_over_x = OneOverX(Value=number_slider)
rotate = Rotate(Geometry=ln, Angle=pi_2, Plane=yz)  # -> Geometry, Transform
rotate_2 = Rotate(Geometry=join.Breps, Angle=pi, Plane=yz)  # -> Geometry, Transform
multiplication = Multiplication(A=division, B=number_slider)
item = ListItem(List=scale_2.Geometry, Index=Slider(30, range=0..100), Wrap=True)
one_over_x_2 = OneOverX(Value=multiplication)
recgrid = Rectangular(Plane=PlaneXY(0, 0, 0), SizeX=one_over_x, SizeY=one_over_x_2, ExtentX=multiplication, ExtentY=number_slider)  # -> Cells, Points
number_slider_2 = Slider(8, range=1..30)
project = Project(Curve=runion, Brep=rotate_2.Geometry, Direction=Vector(0, 0, 1))
number_slider_3 = Slider(8, range=0..10)
number_slider_4 = Slider(2, range=0..10)
image = ImageSampler(
    recgrid.Points,
    FilePath="C:\Users\Antoine\Documents\BMan Modelling\tengwar-annatar-italics-quenya-pangram-e1365130074469.png",
    Filter="Alpha",
    Interpolate=False,
    Umax=1,
    Umin=0,
    Vmax=1,
    Vmin=0,
    Wrap=1)
culln = CullNth(List=scale.Geometry, CullFrequency=2)
number_slider_5 = Slider(1, range=0..1)
rotate_3 = Rotate(Geometry=project, Angle=pi_2, Plane=yz)  # -> Geometry, Transform
recgrid_2 = Rectangular(Plane=PlaneXY(0, 0, 0), SizeX=number_slider_5, SizeY=number_slider_5, ExtentX=multiplication, ExtentY=number_slider)  # -> Cells, Points
sunpath = Ladybug_SunPath(
    location=importepw.location,
    hour=Slider(10, range=0..24),
    day=number_slider_2,
    month=number_slider_3,
    timeStep=1,
    sunPathScale=number_slider_4,
    dailyOrAnnualSunPath=True)  # -> readMe, sunVectors, sunAltitudes, sunAzimuths, port, sunSpheresMesh, sunPathCrvs, compassCrvs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; plug-in component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
sunpath_2 = Ladybug_SunPath(
    location=importepw.location,
    hour=Slider(16, range=0..24),
    day=number_slider_2,
    month=number_slider_3,
    timeStep=1,
    sunPathScale=number_slider_4,
    dailyOrAnnualSunPath=True)  # -> readMe, sunVectors, sunAltitudes, sunAzimuths, port, sunSpheresMesh, sunPathCrvs, compassCrvs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; plug-in component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
panel_2 = Panel(image)
multiplication_2 = Multiplication(A=Slider(8, range=1..10), B=image)
Z = UnitZ(Factor=multiplication_2)
move = Move(Geometry=recgrid_2.Points, Motion=Z)  # -> Geometry, Transform
expression = Expression(u=multiplication, Expression="u+1")
expression_2 = Expression(v=number_slider, Expression="v+1")
gradient = Gradient(LowerLimit=0, UpperLimit=1, Parameter=flatten(panel_2), stops=[0: RGB(255, 255, 255), 1: RGB(0, 0, 0)])
crv = Curve(rotate_3.Geometry)
multiplication_3 = Multiplication(A=sunpath.sunVectors, B=Slider(-51, range=-100..1))
frompoints = MeshFromPoints(Points=flatten(move.Geometry), UDirection=expression, VDirection=expression_2, Colour=gradient)
frompoints_2 = MeshFromPoints(Points=flatten(recgrid_2.Points), UDirection=expression, VDirection=expression_2, Colour=gradient)
null = NullItem(Item=flatten(crv))  # -> NullFlags, InvalidFlags, Description
join_2 = BrepJoin(Breps=srf)  # -> Breps, Closed
equals = Equality(FirstNumber=null.NullFlags, SecondNumber=Toggle(False))  # -> Equality, Inequality
demesh = DeconstructMesh(Mesh=frompoints_2)  # -> Vertices, Faces, Colours, Normals
cull = CullPattern(List=flatten(crv), CullPattern=equals.Equality)
extr = Extrude(Base=flatten(cull), Direction=multiplication_3)
split = SplitBrep(Brep=join_2.Breps, Cutter=extr)
bbx = BrepBrep(BrepA=join_2.Breps, BrepB=extr)  # -> flatten(Curves), Points
lng = ListLength(List=split)
similar = Similarity(FirstNumber=demesh.Colours, SecondNumber="1.732051", Threshold=0.1)  # -> Similarity, AbsoluteDifference
equals_2 = Equality(FirstNumber=similar.Similarity, SecondNumber=Toggle(False))  # -> Equality, Inequality
panel_3 = Panel(lng)
smaller = SmallerThan(FirstNumber=lng, SecondNumber=1)  # -> SmallerThan, OrEqualTo
join_3 = JoinCurves(Curves=bbx.Curves, Preserve=False)
cull_2 = CullPattern(List=demesh.Vertices, CullPattern=equals_2.Equality)
equals_3 = Equality(FirstNumber=smaller.OrEqualTo, SecondNumber=Toggle(False))  # -> Equality, Inequality
cull_3 = CullPattern(List=split, CullPattern=equals_3.Equality)
shift_2 = ShiftList(List=cull_3, Shift=1, Wrap=True)
item_2 = ListItem(List=flatten(cull_3), Index=0, Wrap=True)  # -> flatten(Item)
item_3 = ListItem(List=cull_3, Index=1, Wrap=True)  # -> flatten(Item)
brep = Brep(scale.Geometry)
flip = Flip(Surface=brep)  # -> Surface, Result
sdiff = SolidDifference(BrepsA=item_2, BrepsB=item_3)
panel_4 = Panel(sdiff)
genclimatebasedsky = Honeybee_GenerateClimateBasedSky(weatherFile=epw_stat.epwFile, month=number_slider_3, day=number_slider_2, hour=Slider(10, range=0..24))  # -> radiationValues, skyFilePath; plug-in component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
capex = CapHolesEx(Brep=sdiff)  # -> Brep, Caps, Solid
number_slider_6 = Slider(500, range=0..1000)
sunlighthoursanalysis = Ladybug_SunlightHoursAnalysis(
    geometry=flatten(flip.Surface),
    context=flatten(sdiff),
    gridSize=Slider(1, range=0..10),
    disFromBase=Slider(0.1, range=0..0.1),
    sunVectors=flatten(sunpath_2.sunVectors),
    timeStep=1,
    runIt=Toggle(True))  # -> readMe, contextMesh, analysisMesh, testPts, testVec, port, sunlightHoursResult, sunlightHoursMesh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; plug-in component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
createhbsrfs = Honeybee_createHBSrfs(geometry=sdiff)  # -> readMe, simplify(HBSurface); plug-in component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
imagebasedsimulation = Honeybee_ImageBasedSimulation(
    skyFile=genclimatebasedsky.skyFilePath,
    rhinoViewsName="Perspective",
    cameraType=Slider(1, range=0..2),
    simulationType=2,
    imageWidth=number_slider_6,
    imageHeight=number_slider_6,
    backupImages=0)  # -> analysisRecipe; plug-in component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
rundaylightanalysis = Honeybee_RunDaylightSimulation(analysisRecipe=imagebasedsimulation, overwriteResults=True)  # -> readMe, analysisType, resultsUnit, results, testPts, resultFiles, radGeoFile, studyFolder, done; plug-in component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
